# Grasshopper definition Conformal Mapping.gh (Grasshopper 1.0.7)

mesh = Mesh()
mesh_2 = Mesh()

# ----
# Boundary values must be floats
deconstruct_mesh = DeconstructMesh(Mesh=mesh_2)  # -> Vertices, Faces, Colours, Normals
convex_hull = ConvexHull(Points=deconstruct_mesh.Vertices, Plane=PlaneXY(0, 0, 0))  # -> Hull, HullZ, Indices
list_item = ListItem(List=deconstruct_mesh.Vertices, Index=convex_hull.Indices, Wrap=True)
point_list = PointList(Points=deconstruct_mesh.Vertices, Size=Slider(0.2, range=0..1))
cross_reference = CrossReference(ListListA=list_item, ListListB=list_item, CrossMode=1)  # -> ListListA, ListListB
distance = Distance(PointA=cross_reference.ListListA, PointB=cross_reference.ListListB)
line = Line(StartPoint=cross_reference.ListListA, EndPoint=cross_reference.ListListB)
sort_list = SortList(Keys=distance, ValuesValuesA=line)  # -> Keys, ValuesValuesA
list_item_2 = ListItem(List=reverse(sort_list.ValuesValuesA), Index=0, Wrap=True)
end_points = EndPoints(Curve=list_item_2)  # -> SecondBoundary, FirstBoundary
second_selected_boundary_vertex = Panel(end_points.SecondBoundary)
first_selected_boundary_vertex = Panel(end_points.FirstBoundary)
member_index = MemberIndex(Set=deconstruct_mesh.Vertices, Member=end_points.FirstBoundary)  # -> Index, Count
member_index_2 = MemberIndex(Set=deconstruct_mesh.Vertices, Member=end_points.SecondBoundary)  # -> Index, Count
list_item_3 = ListItem(List=deconstruct_mesh.Vertices, Index=0, Wrap=True)
replace_items = ReplaceItems(List=deconstruct_mesh.Vertices, Item=end_points.FirstBoundary, Indices="0", Wrap=False)
# Boundary
panel = Panel(member_index_2.Index)
replace_items_2 = ReplaceItems(List=replace_items, Item=list_item_3, Indices=member_index.Index, Wrap=False)
panel_2 = Panel(member_index.Index)
list_length = ListLength(List=replace_items_2)
list_item_4 = ListItem(List=replace_items_2, Index=member_index_2.Index, Wrap=True)
boundaries = Point(flatten([end_points.FirstBoundary, end_points.SecondBoundary]))
subtraction = Subtraction(A=list_length, B=1)
replace_items_3 = ReplaceItems(AllVertices=replace_items_2, Item=list_item_4, Indices=subtraction, Wrap=False)
list_item_5 = ListItem(List=replace_items_2, Index=subtraction, Wrap=True)
deconstruct = Deconstruct(Point=boundaries)  # -> XComponent, YComponent, ZComponent
replace_items_4 = ReplaceItems(AllVertices=replace_items_3, Item=list_item_5, Indices=member_index_2.Index, Wrap=False)
last_vertex = Panel(list_item_5)
construct_point = ConstructPoint(XCoordinate=deconstruct.XComponent, YCoordinate=deconstruct.YComponent, ZCoordinate=0)
concatenate = Concatenate(C="[", B="0", Fragment_A=",", Fragment_B=subtraction, A="]")
point_list_2 = PointList(Points=replace_items_4, Size=Slider(0.1, range=0..0.1))
array_for_boundary_vertices = Panel(concatenate)
swapped_vertices_list = Panel(replace_items_4)

panel_3 = Panel(deconstruct_mesh.Faces)
text_fragment = TextFragment(Text=panel_3, Start=Slider(1, range=0..2))
panel_4 = Panel(text_fragment)
replace_text = ReplaceText(Text=text_fragment, Find="{", RecursiveReplace=False)
panel_5 = Panel(replace_text)
replace_text_2 = ReplaceText(Text=replace_text, Find="}", Replace=";", RecursiveReplace=False)
panel_6 = Panel(replace_text_2)
text_split = TextSplit(Text=replace_text_2, Separators=";")
panel_7 = Panel(text_split)
cull_index = CullIndex(List=text_split, Indices="3", Wrap=True)  # -> simplify(List)
ghpython_script = GhPythonScript(x=cull_index, y="0", z=member_index.Index)  # -> out, simplify(a); inputs x: list of Int32, y: Int32
# ---------- ghpython_script: Python ----------
__author__ = "sgupt"
__version__ = "2020.04.26"

import rhinoscriptsyntax as rs

temp = []

for i in x:
    if (i==y):
        temp.append(z)
    elif (i==z):
        temp.append(y)
    else:
        temp.append(i)

a = temp
# ---------- end ghpython_script ----------
panel_8 = Panel(cull_index)
ghpython_script_2 = GhPythonScript(x=ghpython_script.a, y=member_index_2.Index, z=subtraction)  # -> out, simplify(a); inputs x: list of Int32, y: Int32; same code as ghpython_script
list_item_6 = ListItem(List=ghpython_script_2.a, Index=0, Wrap=True)  # -> flatten(Item), flatten(Item1), flatten(Item2)
panel_9 = Panel(ghpython_script_2.a)
mesh_triangle = MeshTriangle(CornerA=list_item_6.Item, CornerB=list_item_6.Item1, CornerC=list_item_6.Item2)
text_join = TextJoin(Text=panel_9, Join=",")
panel_10 = Panel(text_join)
concatenate_2 = Concatenate(Fragment_A="[", Fragment_B=text_join, A="]")  # -> flatten(Result)
panel_11 = Panel(concatenate_2)
text_join_2 = TextJoin(Text=concatenate_2)
array_for_faces = Panel(text_join_2)

replace_text_3 = ReplaceText(Text=replace_items_4, Find="{", Replace="[", RecursiveReplace=False)
# Faces
panel_12 = Panel("")
panel_13 = Panel(replace_text_3)
replace_text_4 = ReplaceText(Text=replace_text_3, Find=" ", Replace=panel_12, RecursiveReplace=False)
# Vertices
panel_14 = Panel(replace_text_4)
replace_text_5 = ReplaceText(Text=replace_text_4, Find="}", Replace="]", RecursiveReplace=False)
panel_15 = Panel(replace_text_5)
text_join_3 = TextJoin(Text=replace_text_5)
array_for_vertices = Panel(text_join_3)

replace_text_6 = ReplaceText(Text=construct_point, Find="{", Replace="[", RecursiveReplace=False)
panel_16 = Panel(replace_text_6)
replace_text_7 = ReplaceText(Text=replace_text_6, Find=" ", Replace=panel_12, RecursiveReplace=False)
panel_17 = Panel(replace_text_7)
replace_text_8 = ReplaceText(Text=replace_text_7, Find=",0}", Replace="]", RecursiveReplace=False)
array_for_boundary_values = Panel(replace_text_8)
list_item_7 = ListItem(List=replace_text_8, Index=0, Wrap=True)  # -> Item, Item1, Item2

c_script = CSharpScript(x=text_join_3, y=text_join_2, z=concatenate, u=list_item_7.Item, v=list_item_7.Item1)  # -> out, A; inputs x: String, y: String, z: String, u: String, v: String
# ---------- c_script: C# usings ----------
using System.IO;
# ---------- c_script: C# ----------
    System.Diagnostics.Process pProcess = new System.Diagnostics.Process();

    //strCommand is path and file name of command to run
    pProcess.StartInfo.FileName = "cmd.exe";


    string result = Path.GetTempPath();
    //Print(result);

    string file_path_vertices = result + "vertices.txt";
    string file_path_faces = result + "faces.txt";

    File.WriteAllText(file_path_vertices, x);
    File.WriteAllText(file_path_faces, y);

    string env = Environment.GetEnvironmentVariable("AppData");

    //strCommandParameters are parameters to pass to program
    // the @ is to make sure the / is not an exit littoral
    // the /c is to carry out the command specified by the string and then terminate
    //pProcess.StartInfo.Arguments = @"/c python C:/Users/sgupt/source/repos/CM_testing_py/CM_testing_py/CM_testing_py.py " + file_path_vertices + " " + file_path_faces + " " + z + " " + u + " " + v;
    //pProcess.StartInfo.Arguments = @"/c C:/Users/sgupt/AppData/Roaming/Grasshopper/Libraries/CM_testing_py/CM_testing_py.exe " + file_path_vertices + " " + file_path_faces + " " + z + " " + u + " " + v;
    pProcess.StartInfo.Arguments = @"/c" + env + "/Grasshopper/Libraries/Conformal_Mapping/CM_testing_py.exe " + file_path_vertices + " " + file_path_faces + " " + z + " " + u + " " + v;


    pProcess.StartInfo.UseShellExecute = false;

    //Set output of program to be written to process output stream
    pProcess.StartInfo.RedirectStandardOutput = true;

    //Optional
    //pProcess.StartInfo.WorkingDirectory = strWorkingDirectory;

    pProcess.StartInfo.CreateNoWindow = true;

    //Start the process
    pProcess.Start();

    //Get program output
    string strOutput = pProcess.StandardOutput.ReadToEnd();

    //Wait for process to finish
    pProcess.WaitForExit();

    File.Delete(file_path_vertices);
    File.Delete(file_path_faces);

    Print(strOutput);
# ---------- end c_script ----------
text_split_2 = TextSplit(Text=c_script.out, Separators="~")
panel_18 = Panel(c_script.out)
list_item_8 = ListItem(List=text_split_2, Index=0, Wrap=True)  # -> Item, Item1

# ----
# Replacing first item
# Replacing last item
# First correct boundary point
# Second correct boundary point
panel_19 = Panel(",")
number_slider = Slider(1, range=0..1)
text_split_3 = TextSplit(Text=list_item_8.Item1, Separators=panel_19)
text_split_4 = TextSplit(Text=list_item_8.Item, Separators=panel_19)
multiplication = Multiplication(A=text_split_3, B=number_slider)
multiplication_2 = Multiplication(A=text_split_4, B=number_slider)
construct_point_2 = ConstructPoint(XCoordinate=multiplication_2, YCoordinate=multiplication, ZCoordinate=0)
number_slider_2 = Slider(0, range=0..100)
list_length_2 = ListLength(List=construct_point_2)
subtraction_2 = Subtraction(A=list_length_2, B=1)
outlier_1 = ListItem(List=construct_point_2, Index=number_slider_2, Wrap=True)
outlier_2 = ListItem(List=construct_point_2, Index=subtraction_2, Wrap=True)
list_item_9 = ListItem(List=deconstruct.XComponent, Index=0, Wrap=True)  # -> Item, Item1
list_item_10 = ListItem(List=deconstruct.YComponent, Index=0, Wrap=True)  # -> Item, Item1
second_boundary_output_coords = Panel(outlier_2)
# 2D Vertices Output
first_boundary_outputs_coords = Panel(outlier_1)
construct_point_3 = ConstructPoint(XCoordinate=list_item_10.Item1, YCoordinate=list_item_9.Item1, ZCoordinate=0)
construct_point_4 = ConstructPoint(XCoordinate=list_item_10.Item, YCoordinate=list_item_9.Item, ZCoordinate=0)
replace_items_5 = ReplaceItems(List=construct_point_2, Item=construct_point_4, Indices=number_slider_2, Wrap=False)
replace_items_6 = ReplaceItems(List=replace_items_5, Item=construct_point_3, Indices=subtraction_2, Wrap=False)
point_list_3 = PointList(Points=replace_items_6, Size=Slider(0.1, range=0..0.2))
construct_mesh = ConstructMesh(Vertices=replace_items_6, Faces=mesh_triangle)

panel_20 = Panel(text_split_2)
point_list_4 = PointList(Points=construct_point_2, Size=Slider(0.2, range=0..0.2))
mesh_3 = Mesh(construct_mesh)
